# Grasshopper definition dragon_curve_v2.gh (Grasshopper 1.0.7)
# Copyright: AMDlab

# STEP 1:既存コンポーネント
panel = Panel("0, 0, 0")  # disabled
panel_2 = Panel("1, 0, 0")  # disabled
panel_3 = Panel("100")  # disabled
# STEP 2:GH_Python
number_slider = Slider(0.59, range=0..14)
line = LineSDL(Start=panel, Direction=panel_2, Length=panel_3)  # disabled

crv = Curve(line)  # disabled
explode = Explode(Curve=crv, Recursive=True)  # -> Segments, Vertices; disabled
panel_4 = Panel("0")  # disabled
midpt = CurveMiddle(Curve=explode.Segments)  # disabled
eval = EvaluateCurve(Curve=explode.Segments, Parameter=panel_4)  # -> Point, Tangent, Angle; disabled
len = Length(Curve=explode.Segments)  # disabled
lng = ListLength(List=explode.Segments)  # disabled
panel_5 = Panel("""90
-90""")  # disabled
rad = Radians(Degrees=panel_5)  # disabled
panel_6 = Panel("2")  # disabled
division = Division(A=len, B=panel_6)  # disabled
repeat = RepeatData(Data=rad, Length=lng)  # disabled
panel_7 = Panel("0, 0, 1")  # disabled
vrot = Rotate(Vector=eval.Tangent, Axis=panel_7, Angle=repeat)  # disabled
panel_8 = Panel("1")  # disabled
multiplication = Multiplication(A=vrot, B=division)  # disabled
series = Series(Start=panel_8, Step=1, Count=lng)  # disabled
addition = Addition(A=midpt, B=multiplication)  # disabled
ins = InsertItems(List=explode.Vertices, Item=addition, Indices=series, Wrap=True)  # disabled
pline = PolyLine(Vertices=ins, Closed=False)  # disabled
crv_2 = Curve(pline)  # disabled

crv_3 = Curve(crv_2)  # disabled
explode_2 = Explode(Curve=crv_3, Recursive=True)  # -> Segments, Vertices; disabled
panel_9 = Panel("0")  # disabled
midpt_2 = CurveMiddle(Curve=explode_2.Segments)  # disabled
eval_2 = EvaluateCurve(Curve=explode_2.Segments, Parameter=panel_9)  # -> Point, Tangent, Angle; disabled
len_2 = Length(Curve=explode_2.Segments)  # disabled
lng_2 = ListLength(List=explode_2.Segments)  # disabled
panel_10 = Panel("""90
-90""")  # disabled
rad_2 = Radians(Degrees=panel_10)  # disabled
panel_11 = Panel("2")  # disabled
division_2 = Division(A=len_2, B=panel_11)  # disabled
repeat_2 = RepeatData(Data=rad_2, Length=lng_2)  # disabled
panel_12 = Panel("0, 0, 1")  # disabled
vrot_2 = Rotate(Vector=eval_2.Tangent, Axis=panel_12, Angle=repeat_2)  # disabled
panel_13 = Panel("1")  # disabled
multiplication_2 = Multiplication(A=vrot_2, B=division_2)  # disabled
series_2 = Series(Start=panel_13, Step=1, Count=lng_2)  # disabled
addition_2 = Addition(A=midpt_2, B=multiplication_2)  # disabled
ins_2 = InsertItems(List=explode_2.Vertices, Item=addition_2, Indices=series_2, Wrap=True)  # disabled
pline_2 = PolyLine(Vertices=ins_2, Closed=False)  # disabled
crv_4 = Curve(pline_2)  # disabled

crv_5 = Curve(crv_4)  # disabled
explode_3 = Explode(Curve=crv_5, Recursive=True)  # -> Segments, Vertices; disabled
panel_14 = Panel("0")  # disabled
midpt_3 = CurveMiddle(Curve=explode_3.Segments)  # disabled
eval_3 = EvaluateCurve(Curve=explode_3.Segments, Parameter=panel_14)  # -> Point, Tangent, Angle; disabled
len_3 = Length(Curve=explode_3.Segments)  # disabled
lng_3 = ListLength(List=explode_3.Segments)  # disabled
panel_15 = Panel("""90
-90""")  # disabled
rad_3 = Radians(Degrees=panel_15)  # disabled
panel_16 = Panel("2")  # disabled
division_3 = Division(A=len_3, B=panel_16)  # disabled
repeat_3 = RepeatData(Data=rad_3, Length=lng_3)  # disabled
panel_17 = Panel("0, 0, 1")  # disabled
vrot_3 = Rotate(Vector=eval_3.Tangent, Axis=panel_17, Angle=repeat_3)  # disabled
panel_18 = Panel("1")  # disabled
multiplication_3 = Multiplication(A=vrot_3, B=division_3)  # disabled
series_3 = Series(Start=panel_18, Step=1, Count=lng_3)  # disabled
addition_3 = Addition(A=midpt_3, B=multiplication_3)  # disabled
ins_3 = InsertItems(List=explode_3.Vertices, Item=addition_3, Indices=series_3, Wrap=True)  # disabled
pline_3 = PolyLine(Vertices=ins_3, Closed=False)  # disabled
crv_6 = Curve(pline_3)  # disabled

crv_7 = Curve(crv_6)  # disabled
explode_4 = Explode(Curve=crv_7, Recursive=True)  # -> Segments, Vertices; disabled
panel_19 = Panel("0")  # disabled
midpt_4 = CurveMiddle(Curve=explode_4.Segments)  # disabled
eval_4 = EvaluateCurve(Curve=explode_4.Segments, Parameter=panel_19)  # -> Point, Tangent, Angle; disabled
len_4 = Length(Curve=explode_4.Segments)  # disabled
lng_4 = ListLength(List=explode_4.Segments)  # disabled
panel_20 = Panel("""90
-90""")  # disabled
rad_4 = Radians(Degrees=panel_20)  # disabled
panel_21 = Panel("2")  # disabled
division_4 = Division(A=len_4, B=panel_21)  # disabled
repeat_4 = RepeatData(Data=rad_4, Length=lng_4)  # disabled
panel_22 = Panel("0, 0, 1")  # disabled
vrot_4 = Rotate(Vector=eval_4.Tangent, Axis=panel_22, Angle=repeat_4)  # disabled
panel_23 = Panel("1")  # disabled
multiplication_4 = Multiplication(A=vrot_4, B=division_4)  # disabled
series_4 = Series(Start=panel_23, Step=1, Count=lng_4)  # disabled
addition_4 = Addition(A=midpt_4, B=multiplication_4)  # disabled
ins_4 = InsertItems(List=explode_4.Vertices, Item=addition_4, Indices=series_4, Wrap=True)  # disabled
pline_4 = PolyLine(Vertices=ins_4, Closed=False)  # disabled
crv_8 = Curve(pline_4)  # disabled

crv_9 = Curve(crv_8)  # disabled
explode_5 = Explode(Curve=crv_9, Recursive=True)  # -> Segments, Vertices; disabled
panel_24 = Panel("0")  # disabled
midpt_5 = CurveMiddle(Curve=explode_5.Segments)  # disabled
eval_5 = EvaluateCurve(Curve=explode_5.Segments, Parameter=panel_24)  # -> Point, Tangent, Angle; disabled
len_5 = Length(Curve=explode_5.Segments)  # disabled
lng_5 = ListLength(List=explode_5.Segments)  # disabled
panel_25 = Panel("""90
-90""")  # disabled
rad_5 = Radians(Degrees=panel_25)  # disabled
panel_26 = Panel("2")  # disabled
division_5 = Division(A=len_5, B=panel_26)  # disabled
repeat_5 = RepeatData(Data=rad_5, Length=lng_5)  # disabled
panel_27 = Panel("0, 0, 1")  # disabled
vrot_5 = Rotate(Vector=eval_5.Tangent, Axis=panel_27, Angle=repeat_5)  # disabled
panel_28 = Panel("1")  # disabled
multiplication_5 = Multiplication(A=vrot_5, B=division_5)  # disabled
series_5 = Series(Start=panel_28, Step=1, Count=lng_5)  # disabled
addition_5 = Addition(A=midpt_5, B=multiplication_5)  # disabled
ins_5 = InsertItems(List=explode_5.Vertices, Item=addition_5, Indices=series_5, Wrap=True)  # disabled
pline_5 = PolyLine(Vertices=ins_5, Closed=False)  # disabled
crv_10 = Curve(pline_5)  # disabled

crv_11 = Curve(crv_10)  # disabled
explode_6 = Explode(Curve=crv_11, Recursive=True)  # -> Segments, Vertices; disabled
panel_29 = Panel("0")  # disabled
midpt_6 = CurveMiddle(Curve=explode_6.Segments)  # disabled
eval_6 = EvaluateCurve(Curve=explode_6.Segments, Parameter=panel_29)  # -> Point, Tangent, Angle; disabled
len_6 = Length(Curve=explode_6.Segments)  # disabled
lng_6 = ListLength(List=explode_6.Segments)  # disabled
panel_30 = Panel("""90
-90""")  # disabled
rad_6 = Radians(Degrees=panel_30)  # disabled
panel_31 = Panel("2")  # disabled
division_6 = Division(A=len_6, B=panel_31)  # disabled
repeat_6 = RepeatData(Data=rad_6, Length=lng_6)  # disabled
panel_32 = Panel("0, 0, 1")  # disabled
vrot_6 = Rotate(Vector=eval_6.Tangent, Axis=panel_32, Angle=repeat_6)  # disabled
panel_33 = Panel("1")  # disabled
multiplication_6 = Multiplication(A=vrot_6, B=division_6)  # disabled
series_6 = Series(Start=panel_33, Step=1, Count=lng_6)  # disabled
addition_6 = Addition(A=midpt_6, B=multiplication_6)  # disabled
ins_6 = InsertItems(List=explode_6.Vertices, Item=addition_6, Indices=series_6, Wrap=True)  # disabled
pline_6 = PolyLine(Vertices=ins_6, Closed=False)  # disabled
crv_12 = Curve(pline_6)  # disabled

python = GhPythonScript(foldCount=number_slider, lineLen=Slider(100, range=1..100), widthPerLL=Slider(0.1, range=0..1))  # -> out, a, w
# ---------- python: Python ----------
from Rhino.Geometry import Point3d, Polyline
from math import floor, sqrt

fCInt = int(floor(foldCount))
dLen = lineLen/sqrt(2)**foldCount

w = widthPerLL * dLen
pts = [Point3d(0., 0., 0.), Point3d(lineLen, 0., 0.)]

flag = True
for i in range(fCInt):
    for j in range(len(pts)-2, -1, -1):
        cp = (pts[j] + pts[j+1])/2
        v = pts[j+1] - cp
        flagNum = (flag-0.5) * 2
        newP = cp + Point3d(v.Y * -flagNum, v.X *  flagNum, 0)
        pts.insert(j+1, newP)
        flag = not flag
    

d = foldCount % 1
for j in range(len(pts)-2, -1, -1):
    cp = (pts[j] + pts[j+1])/2
    v = pts[j+1] - cp
    flagNum = (flag-0.5) * 2
    newP = cp + Point3d(v.Y * -flagNum * d, v.X *  flagNum * d, 0)
    pts.insert(j+1, newP)
    
    flag = not flag

a = Polyline(pts)
a = a.ToNurbsCurve()
# ---------- end python ----------
explode_7 = Explode(Curve=python.a, Recursive=True)  # -> Segments, Vertices
neg = Negative(Value=python.w)
offset = OffsetCurve(Curve=graft(explode_7.Segments), Distance=[python.w, neg], Corners=1)  # -> simplify(Curve)
trim = TrimTree(Tree=offset, Depth=1)
swatch = ColourSwatch(SwatchColor=RGB(0, 0, 0))
loft = Loft(Curves=trim, Options={Adjust=False, Closed=False, LoftEnds=0, LoftSimp=0, LoftType=0, Rebuild=10, Refit=0.01})
preview = CustomPreview(Geometry=loft, Material=swatch)
dots = DotDisplay(Point=explode_7.Vertices, Colour=swatch, Size=python.w)
